# Grasshopper definition Depth Sampling along path.gh (Grasshopper 1.0.7)

number_slider = Slider(0, range=0..200)
# ground
number_slider_2 = Slider(73, range=0..100)
geo = Geometry([<brep referenced from the Rhino model> x456])
geo_2 = Geometry(<brep referenced from the Rhino model>)
series = Series(Start=number_slider, Step=1, Count=Slider(100, range=0..1000))
crv = Curve([<curve referenced from the Rhino model> x100])
geo_3 = Geometry([geo, geo_2])
item = ListItem(List=crv, Index=series, Wrap=True)
divide = DivideCurve(Curve=item, Count=Slider(29, range=0..100), Kinks=False)  # -> Points, Tangents, Parameters
number_slider_3 = Slider(20, range=0..50)
panel = Panel(item)
item_2 = ListItem(List=geo_3, Index=number_slider_2, Wrap=True)
number_slider_4 = Slider(20, range=0..100)
item_3 = ListItem(List=crv, Index=0, Wrap=True)
divlength = DivideLength(Curve=item, Length=Slider(5, range=0..100))  # -> Points, Tangents, Parameters
python = GhPythonScript(ViewPt=divide.Points, Obst_Obj=geo_3, Radius=number_slider_3, start=Toggle(False), start_idx=number_slider)  # -> out, a; inputs ViewPt: tree of Point3d, Obst_Obj: list, start: Boolean
# ---------- python: Python ----------
__author__ = "Administrator"
__version__ = "2023.04.17"

import rhinoscriptsyntax as rs
import Rhino.Geometry as rg
import math
import os
import System.Drawing as sd
import Rhino
import scriptcontext


def create_rtree(obstruction_objects):
    r_tree = rg.RTree()
    for i, obj in enumerate(obstruction_objects):
        if obj is None:
            print("Obstruction object at index {} is None.".format(i))
            continue
        bbox = obj.GetBoundingBox(True)
        r_tree.Insert(bbox, i)
    return r_tree

def distance_to_obstructions(viewpoint, direction, obstruction_objects, max_distance, rtree):
    ray = rg.Ray3d(viewpoint, direction)
    ray_line = rg.Line(ray.PointAt(0), ray.PointAt(max_distance))
    ray_line_bbox = ray_line.ToNurbsCurve().GetBoundingBox(True)

    intersections = []
    def callback(sender, e):
        intersections.append(e.Id)

    rtree.Search(ray_line_bbox, callback)

    if intersections:
        brep_objects = [obstruction_objects[i] for i in intersections]

        # New code to limit intersection tests:
        search_radius = max_distance  # Define a search radius
        brep_objects = [brep for brep in brep_objects if brep.ClosestPoint(viewpoint).DistanceTo(viewpoint) < search_radius]

        ray_intersections = rg.Intersect.Intersection.RayShoot(ray, brep_objects, 1)
        if ray_intersections:
            distances = [viewpoint.DistanceTo(x) for x in ray_intersections]
            min_distance = min(max_distance, min(distances))
            return min_distance

    return max_distance

def create_panoramic_image(viewpoint, sphere_radius, obstruction_objects, img_width, img_height, rtree):
    n = 1
    img = sd.Bitmap(img_width*n, img_height*n)
    theta_range = (0, 2 * math.pi)
    phi_range = (-math.pi/2, math.pi/2)
    sphere_pts=[]
    
    for x in range(img_width*n):
        for y in range(img_height*n):
            theta =theta_range[0] + (theta_range[1] - theta_range[0]) * float(x) / (img_width*n)
            h = 2*math.pi - (phi_range[0] + (phi_range[1] - phi_range[0]) * float(y) / (img_height*n))
            sphere_pt = rg.Sphere(viewpoint, sphere_radius).PointAt(theta, h)
            sphere_pts.append(sphere_pt)
            direction = sphere_pt - viewpoint
            direction.Unitize()
            #print(direction)
            distance = distance_to_obstructions(viewpoint, direction, obstruction_objects, sphere_radius,rtree)
            grayscale_value = int((distance / sphere_radius) * 255)
            color = sd.Color.FromArgb(grayscale_value, grayscale_value, grayscale_value)
            img.SetPixel(x, y, color)
    return img,sphere_pts

def centralize_darkest_column(img):
    darkest_column_sum = img.GetPixel(0, 0).ToArgb()
    darkest_column_index = 0

    for x in range(img.Width):
        column_sum = 0
        for y in range(img.Height):
            column_sum += img.GetPixel(x, y).ToArgb()
        if column_sum < darkest_column_sum:
            darkest_column_sum = column_sum
            darkest_column_index = x

    if darkest_column_index <= img.Width // 2:
        shift = img.Width // 2 - darkest_column_index
    else:
        shift = img.Width - (darkest_column_index - img.Width // 2)

    img_centered = sd.Bitmap(img.Width, img.Height)
    for x in range(img.Width):
        for y in range(img.Height):
            img_centered.SetPixel((x + shift) % img.Width, y, img.GetPixel(x, y))

    return img_centered

def save_panoramic_image(img, path, index,start_idx):
    file_path = Rhino.RhinoDoc.ActiveDoc.Path
    file_directory = os.path.dirname(file_path)
    path_directory = os.path.join(file_directory, "path{:02d}".format(path+int(start_idx)))
    if not os.path.exists(path_directory):
        os.makedirs(path_directory)
    img.Save(os.path.join(path_directory, "panoramic_{:02d}.png".format(index)))
    print("Successfully saved of path {:02d} ".format(path))

def create_depth_panoramic(ViewPt, Obst_Obj, Radius,start_idx):
    img_width = 60
    img_height = 30
    
    obstruction_breps = [rs.coercegeometry(guid) for guid in Obst_Obj]
    rtree = create_rtree(obstruction_breps)

    for i in range(ViewPt.BranchCount):
        path = ViewPt.Branch(i)
        for j, viewpoint in enumerate(path):
            img,_ = create_panoramic_image(viewpoint, Radius, obstruction_breps, img_width, img_height, rtree)
            img = centralize_darkest_column(img)
            save_panoramic_image(img,i,j,start_idx)


if start:
    create_depth_panoramic(ViewPt, Obst_Obj, Radius,start_idx)
# ---------- end python ----------
sph = Sphere(Base=divide.Points, Radius=number_slider_3)
panel_2 = Panel(python.out)
item_4 = ListItem(Index=Slider(63, range=0..100), Wrap=True)
sph_2 = Sphere(Base=PlaneXY(0, 0, 0), Radius=Slider(40, range=0..100))
panel_3 = Panel(divide.Points)
