# Grasshopper definition PedSimFlowScript.gh (Grasshopper 1.0.7)
# plug-ins: PedSimulation, EleFront, Human, eleFront

swatch = ColourSwatch(SwatchColor=RGB(126, 154, 247))

# ----
# Start Point(s)
panel = Panel("Start")
reflay = ReferenceByLayer(LayerName=panel, lightweight=False)

swatch_2 = ColourSwatch(SwatchColor=RGB(0, 0, 0))
swatch_3 = ColourSwatch(SwatchColor=RGB(255, 184, 97))
program = ProgramComponent(ProgramName="Interior", DisplayColor=swatch)
program_2 = ProgramComponent(ProgramName="Other", DisplayColor=swatch_2)
program_3 = ProgramComponent(ProgramName="Column", DisplayColor=swatch_3)
# Visit Point(s)
reflay_2 = ReferenceByLayer(LayerName="Column")
reflay_3 = ReferenceByLayer(LayerName="Other")
reflay_4 = ReferenceByLayer(LayerName="Interior")

# ----
# End Point(s)
panel_2 = Panel("End")
reflay_5 = ReferenceByLayer(LayerName=panel_2)

reflay_6 = ReferenceByLayer(LayerName=panel_2, lightweight=False)
reflay_7 = ReferenceByLayer(LayerName=<missing>)
reflay_8 = ReferenceByLayer(LayerName="Other", lightweight=False)
reflay_9 = ReferenceByLayer(LayerName="Column", lightweight=False)
reflay_10 = ReferenceByLayer(LayerName="Interior", lightweight=False)
panel_3 = Panel(reflay)
dots = DotDisplay(Point=reflay_9, Colour=swatch_3, Size=Slider(0.06, range=0..0.1))
dots_2 = DotDisplay(Point=reflay_10, Colour=swatch, Size=Slider(0.06, range=0..0.1))
dots_3 = DotDisplay(Point=reflay_8, Colour=swatch_2, Size=Slider(0.06, range=0..0.1))
pill_tag = BooleanToggle(True)
pill_tag_2 = BooleanToggle(True)
merge = Merge(Data2=program, Data3=program_2)
pill_tag_3 = BooleanToggle(True)
number_slider = Slider(2, range=0..10)
number_slider_2 = Slider(10, range=0..500)
gate = Gate(
    Position=reflay,
    GateName="Start",
    ExitTime=Slider(0, range=0..1),
    AccessRadius=Slider(1, range=0..1),
    DrawDot=pill_tag,
    Color=ColourSwatch(SwatchColor=RGB(173, 56, 71)))
gate_2 = Gate(
    Position=reflay_6,
    GateName="End",
    ExitTime=Slider(0, range=0..1),
    AccessRadius=Slider(1, range=0..1),
    DrawDot=pill_tag_2,
    Color=ColourSwatch(SwatchColor=RGB(126, 154, 247)))
crossref = CrossReference(ListA=gate, ListB=gate_2, CrossMode=1)  # -> ListA, ListB
target = Target(
    Position=reflay_9,
    Program=program_3,
    VisitingTime=number_slider_2,
    AccessRadius=number_slider,
    DrawDot=pill_tag_3,
    createMultipleTargets=True)
body_width = Slider(0.55, range=0.3..0.95)
target_2 = Target(
    Position=reflay_10,
    Program=program,
    VisitingTime=number_slider_2,
    AccessRadius=number_slider,
    DrawDot=pill_tag_3,
    createMultipleTargets=True)
target_3 = Target(
    Position=reflay_8,
    Program=program_2,
    VisitingTime=number_slider_2,
    AccessRadius=number_slider,
    DrawDot=pill_tag_3,
    createMultipleTargets=True)
fanvision = FanShapedVision(Angle=149.994, Distance=50)
merge_2 = Merge(Data2=target_2, Data3=target_3)

# ----
# Obstacle Curves
spawn_time = Slider(40, range=1..100, expression="x/4")

pt = PersonTemplate(
    StartGate=crossref.ListA,
    DestinationGate=crossref.ListB,
    Interests=merge,
    NeedValue=Slider(10, range=0..10),
    StartNumber=0,
    Probability=Slider(1, range=0..10),
    TimeLimit=-1,
    Vision=fanvision,
    BodyRadius=expr("x/2", body_width),
    TargetForce=20,
    DisplayColor=ColourSwatch(SwatchColor=RGB(252, 177, 97)),
    PersonTemplateDirectionMode=1)
pill_tag_4 = BooleanToggle(True)

# ----
# Reset Simulation
button = Button()

dam = DataDam(DataA=merge_2, BufferDelay=10000000, BufferMode=0)
crv = Curve([<curve referenced from the Rhino model> x7])
cls = Closed(Curve=crv)  # -> Closed, Periodic
dam_2 = DataDam(DataA=pt, BufferDelay=10000000, BufferMode=0)
settings = SystemSettings(
    FPS=30,
    ObstacleOffset=1,
    ObstacleRepulsionCoefA=50,
    ObstacleRepulsionCoefB=2,
    ObstacleRepulsionMax=5,
    ObstacleRepulsionThreshold=0.5,
    EnableTrace=pill_tag_4)
dispatch = Dispatch(List=crv, DispatchPattern=cls.Closed)  # -> ListA, ListB
crv_2 = Curve(dispatch.ListA)
panel_4 = Panel(crv)

# ----
# Trigger
timer = Timer(Interval=100, TimerInterval=100, Target=pedsim)  # disabled

pedsim = PedSimulationSystem(
    Reset=button,
    PersonTemplates=dam_2,
    ObstacleCurves=crv_2,
    Population=Slider(10, range=0..20),
    Targets=dam,
    GenerationTime=spawn_time,
    SystemSettings=settings)  # -> Out, People, GraphEdges, GraphVertices, GoalTagPositions, VisitCounts, PersonRecords
deconspr = DeconstructPersonRecord(PersonRecord=pedsim.PersonRecords)  # -> PersonID, TemplateID, StartTime, EndTime, TimeSequence, TracePositions, TraceSpeeds, StateSequence
pline = PolyLine(Vertices=deconspr.TracePositions, Closed=False)
line = Line(pedsim.GraphEdges)
material = CreateMaterial(
    Diffuse=ColourSwatch(SwatchColor=RGB(252, 177, 97)),
    Specular=RGB(255, 255, 255),
    Emission=RGB(0, 0, 0),
    Transparency=0,
    Shine=0)
deconsp = DeconstructPerson(Person=pedsim.People)  # -> ID, TemplateID, Position, BodyRadius, Velocity, Acceleration, CurrentPath, Behaviors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
drawperson = DrawPerson(People=pedsim.People, FOVMaterial=material, drawCurrentTargetFill=True, drawFOV=False, drawNumber=False)

# ----
# Preview Sightline
drawperson_2 = DrawPerson(People=pedsim.People, drawCurrentTargetFill=True, drawFOV=True, drawNumber=True)

lng = ListLength(List=pedsim.People)
series = Series(Start=0, Step=1, Count=Slider(125, range=0..150))
item = ListItem(List=flatten(pline), Index=series, Wrap=True)
panel_5 = Panel(deconspr.TracePositions)
previewlw = CustomPreviewLineweights(Geometry=item, Shader=ColourSwatch(SwatchColor=RGB(255, 240, 77)), Absolute=False)

# ----
# Preview Points/Paths
pt_2 = Point(deconsp.Position)
crv_3 = Curve(deconsp.CurrentPath)

# ----
# Population In-Game
panel_6 = Panel(lng)

panel_7 = Panel(pline)
dots_4 = DotDisplay(Point=pt_2, Colour=ColourSwatch(SwatchColor=RGB(33, 32, 31)), Size=Slider(0.3, range=0..1))
# Path
crv_4 = Curve([<curve referenced from the Rhino model> x125])
# Ground Surface
srf = Surface([<surface referenced from the Rhino model> x22])
cp = ControlPoints(Curve=crv_4)  # -> Points, Weights, Knots
Z = UnitZ(Factor=1)
project = ProjectPoint(Point=cp.Points, Direction=Z, Geometry=srf)  # -> Point, Index
Z_2 = UnitZ(Factor=Slider(1.6, range=0..10))
move = Move(Geometry=project.Point, Motion=Z_2)  # -> Geometry, Transform
pline_2 = PolyLine(Vertices=move.Geometry, Closed=False)
